# Dynamo graph PythonTemplateNonica_v1.0.dyn (Dynamo 2.6.2.15705)

my_python_template = Python()
# ---------- my_python_template.python (480 lines) ----------
################################

#LIBRARIES. 

################################
import sys
import clr
import os
#System classes and methods.
clr.AddReference("System.Core")
import System
from System                     import Array, Enum
from System.IO                  import *
from System.Collections.Generic import List
#Access to Revit classes and methods.
clr.AddReference('RevitAPI')
clr.AddReference("RevitAPIUI")
clr.AddReference("RevitServices")
import Autodesk
from Autodesk.Revit.DB         import *
from Autodesk.Revit.UI         import *
from RevitServices.Persistence import DocumentManager
#Access to Windows Forms and other libraries for UI/UX.
clr.AddReference('System.Data')
clr.AddReference('System.Drawing')
clr.AddReference('System.Windows.Forms')
clr.AddReference('System.Threading.Tasks')
from System.Data            import *
from System.Drawing         import *
from System.Windows.Forms   import *
from System.Threading.Tasks import Task

################################

#CUSTOM CLASSES. To later use custom objects.

################################

#(If any)

################################

#EXTERNAL EVENTS. Called from the main window to modify the document.

################################
			
class myExternalEvent(IExternalEventHandler):		
	def Execute(self, uiapp):
		try:
			#Basic variables
			global doc
			global rvt_ver
			uidoc   = uiapp.ActiveUIDocument
			doc     = uidoc.Document
			rvt_ver = int(uiapp.Application.VersionNumber)
			
			#Get information from control main window using main window object. 
				#data = mainWindow._control
				#For example, if we have a CheckedListBox, we can get the checked items.
				#list_element_ids_to_process = [item["Value"] for item in mainWindow._checklistbox.CheckedItems]
			list_element_ids_to_process = [1, 2, 3, 4, 5]
			
			#Progress/loading bar. Hide main window and show progress window.
			global windowProgress
			windowProgress = WindowWithProgresBar()
			num_items      = len(list_element_ids_to_process)
			windowProgress._progressBar.Maximum = num_items
			windowProgress._progressBar.Minimum = 0
			windowProgress._progressBar.Step    = 1
			mainWindow.Hide()
			windowProgress.Show()
			
			#A transaction needed to modify the Revit document.
			with Transaction(doc, "Transaction Name") as tr:
				tr.Start()
				#Iterate to process each element.
				for counter, item in enumerate(list_element_ids_to_process):
					#Update progress bar while loading.
					windowProgress._txtBlock.Text = str(counter) + " / " + str(num_items) + " Items Processed"
					windowProgress._progressBar.PerformStep()
					windowProgress.Refresh()
					Application.DoEvents()
					if windowProgress.interrupt == True:
						#Check if process should be interrupted
						break
					
					###
					#Your code to process comes here.
					###
					
					#Delete the 2 lines below (time.sleep), only for visualization purposes.
					import time
					time.sleep(0.5)
				if windowProgress.interrupt == True:
					tr.RollBack()
				else:
					tr.Commit()

			if windowProgress.interrupt == True:
				#If process was interrupted, show message to user.
				windowProgress.Close()
				Autodesk.Revit.UI.TaskDialog.Show("Process Cancelled","The process has been interrupted / cancelled.\n\n" + "No changes were applied to the document.")
			else:
				#If not interrupted, just close progress bar.
				windowProgress.Close()
			#Show main window and reactivate controls
			mainWindow.Show()	
			mainWindow.EnableDisableRunningControls(True)
		except Exception as e:
			#If there is a exception, show exception message and line in code.
			windowProgress.Close()
			Autodesk.Revit.UI.TaskDialog.Show("Exception", str(e) + " - " + str(sys.exc_info()[-1].tb_lineno))
			#Show main window and reactivate controls
			mainWindow.Show()
			mainWindow.EnableDisableRunningControls(True)					
	        
	def GetName(self):
		return "Name Event"		

################################

#WINDOWS. To interact with the user and gather inputs.

################################

class MainWindow(Form):
	def __init__(self, ex_event):
		#Basic window variables.
		self.Font = Font(self.Font.FontFamily, 16, FontStyle.Regular, GraphicsUnit.Pixel)
		self.ext_ev = ex_event
		self.InitializeComponent()

	def InitializeComponent(self):
		#Controls in window (buttons, ...)
		self._spr_top          = System.Windows.Forms.Label()
		self.groupFolder       = System.Windows.Forms.GroupBox()
		self._tlTip            = System.Windows.Forms.ToolTip()
		self._txtBox           = System.Windows.Forms.TextBox()
		self._btn_extra        = System.Windows.Forms.Button()
		self._chckBoxRcsv      = System.Windows.Forms.CheckBox()
		self._btn_main         = System.Windows.Forms.Button()
		self.SuspendLayout()
		# 
		# Top branded line
		# 
		self._spr_top.Anchor     = System.Windows.Forms.AnchorStyles.Top | System.Windows.Forms.AnchorStyles.Left | System.Windows.Forms.AnchorStyles.Right
		self._spr_top.Location   = System.Drawing.Point(0, 0)
		self._spr_top.Name       = "spr_top"
		self._spr_top.Size       = System.Drawing.Size(5000, 2)
		self._spr_top.BackColor  = Color.FromArgb(82, 53, 239)
		# 
		# Sample Textbox
		#
		self._txtBox.Anchor   = System.Windows.Forms.AnchorStyles.Top | System.Windows.Forms.AnchorStyles.Left | System.Windows.Forms.AnchorStyles.Right
		self._txtBox.Location = System.Drawing.Point(10, 25)
		self._txtBox.Name     = "txtBox"
		self._txtBox.Size     = System.Drawing.Size(75, 23)
		self._txtBox.Text     = "Sample TextBox"
		self._tlTip.SetToolTip(self._txtBox, "Tooltip when mouse is over")
		self.groupFolder.Controls.Add(self._txtBox)
		# 
		# Sample Button
		# 
		self._btn_extra.Anchor    = System.Windows.Forms.AnchorStyles.Top | System.Windows.Forms.AnchorStyles.Right 
		self._btn_extra.Location  = System.Drawing.Point(95, 24)
		self._btn_extra.Name      = "btn_extra"
		self._btn_extra.Size      = System.Drawing.Size(95, 29)
		self._btn_extra.Text      = "Button"
		self._btn_extra.Cursor    = Cursors.Hand
		self._btn_extra.Click    += self.click_extraProcess
		self._tlTip.SetToolTip(self._btn_extra, "Tooltip when mouse is over")
		self.groupFolder.Controls.Add(self._btn_extra)
		# 
		# Sample Checkbox
		# 
		self._chckBoxRcsv.Anchor   = System.Windows.Forms.AnchorStyles.Top | System.Windows.Forms.AnchorStyles.Left
		self._chckBoxRcsv.Location = System.Drawing.Point(12, 55)
		self._chckBoxRcsv.Name     = "radiobutton2"
		self._chckBoxRcsv.Size     = System.Drawing.Size(300, 25)
		self._chckBoxRcsv.Text     = "Sample Checkbox."
		self._chckBoxRcsv.Checked  = True
		self._tlTip.SetToolTip(self._chckBoxRcsv, "Tooltip when mouse is over")
		self.groupFolder.Controls.Add(self._chckBoxRcsv)
		# 
		# Group of Controls
		#
		self.groupFolder.Text     = "Group of Controls"
		self.groupFolder.Location = System.Drawing.Point(12, 5)
		self.groupFolder.Size     = System.Drawing.Size(530, 85)
		# 
		# Button Main
		# 
		self._btn_main.Anchor    = System.Windows.Forms.AnchorStyles.Top | System.Windows.Forms.AnchorStyles.Left | System.Windows.Forms.AnchorStyles.Right  
		self._btn_main.Location  = System.Drawing.Point(12, 100)
		self._btn_main.Name      = "btn_main"
		self._btn_main.Size      = System.Drawing.Size(530, 30)
		self._btn_main.Text      = "Sample Loading Process"
		self._btn_main.Cursor    = Cursors.Hand
		self._btn_main.Click    += self.click_mainProcess
		self._tlTip.SetToolTip(self._btn_main, "Tooltip when mouse is over.")
		# 
		# General settings window (size, topmost, ...)
		# 
		self.ClientSize = System.Drawing.Size(554, 145)
		self.MaximizeBox = 0
		self.MinimizeBox = 0
		self.CenterToScreen() 
		self.FormBorderStyle = FormBorderStyle.FixedSingle
		self.Controls.Add(self._spr_top)
		self.Controls.Add(self.groupFolder)
		self.Controls.Add(self._btn_main)
		self.Name = "Name Small Tool"
		self.Text = "Name Small Tool"
		self.TopMost = True
		#Icons to show in the corner of the window.
		#iconFilename = 'C:\\NONICAPRO\\OtherFiles\\System\\Nonicafavicon.ICO'
		#if not os.path.exists(iconFilename):
			#iconFilename = 'C:\\NONICA\\OtherFiles\\System\\Nonicafavicon.ICO'
		#icon = Icon(iconFilename)
		#self.Icon = icon
		self.ResumeLayout(False)
		
	def EnableDisableRunningControls(self, IsEnabled):
		self.groupFolder.Enabled = IsEnabled
		self._btn_main.Enabled   = IsEnabled
		if IsEnabled == False:
			#In case, there is another command blocking Revit, let the user know.
			self._btn_main.Text = "Revit is Blocked (Other command being run). Press Esc"
		else:
			#Set original button text after processing
			self._btn_main.Text = "Sample Loading Process"
            
	def click_mainProcess(self, sender, e):
		#Disable controls
		self.EnableDisableRunningControls(False)
		#Run external event
		self.ext_ev.Raise()
	
	def click_extraProcess(self, sender, e):
		#Sample Action
		self.Hide()
		Autodesk.Revit.UI.TaskDialog.Show("Sample Button Click","Sample message to show to the user.")
		self.Show()

class WindowWithProgresBar(Form):
	def __init__(self):
		#Basic window variables and events.
		self.Font      = Font("Arial", 15, FontStyle.Regular, GraphicsUnit.Pixel)
		self.interrupt = False
		self.TopMost   = True
		self.Closing  += self.closingevent
		self.InitializeComponent()
		
	def InitializeComponent(self):
		#Controls in window (buttons, ...)
		self._spr_top      = System.Windows.Forms.Label()
		self._progressBar  = System.Windows.Forms.ProgressBar()
		self._btn_inter    = System.Windows.Forms.Button()
		self._txtBlock     = System.Windows.Forms.Label()
		self.SuspendLayout()
		# 
		# Top branded line.
		# 
		self._spr_top.Anchor     = System.Windows.Forms.AnchorStyles.Top | System.Windows.Forms.AnchorStyles.Left | System.Windows.Forms.AnchorStyles.Right
		self._spr_top.Location   = System.Drawing.Point(0, 0)
		self._spr_top.Name       = "spr_branded_line"
		self._spr_top.Size       = System.Drawing.Size(2000, 2)
		self._spr_top.BackColor  = Color.FromArgb(82, 53, 239)
		# 
		# TextBlock
		# 
		self._txtBlock.Anchor    = System.Windows.Forms.AnchorStyles.Top | System.Windows.Forms.AnchorStyles.Left
		self._txtBlock.TextAlign = ContentAlignment.MiddleCenter
		self._txtBlock.Location  = System.Drawing.Point(0, 5)
		self._txtBlock.Name      = "txt_items"
		self._txtBlock.Size      = System.Drawing.Size(250, 20)
		self._txtBlock.Text      = "0 / 0 Items Processed"
		# 
		# ProgressBar
		# 
		self._progressBar.Anchor   = System.Windows.Forms.AnchorStyles.Bottom | System.Windows.Forms.AnchorStyles.Left
		self._progressBar.Location = System.Drawing.Point(15, 30)
		self._progressBar.Name     = "prg_bar"
		self._progressBar.Size     = System.Drawing.Size(220, 15)
		self._progressBar.Value    = 0
		# 
		# Button Interrupt
		# 
		self._btn_inter.Anchor   = System.Windows.Forms.AnchorStyles.Bottom | System.Windows.Forms.AnchorStyles.Right
		self._btn_inter.Location = System.Drawing.Point(14, 50)
		self._btn_inter.Name     = "btn_interrupt"
		self._btn_inter.Size     = System.Drawing.Size(222, 20)
		self._btn_inter.Text     = "Interrupt / Cancel"
		self._btn_inter.Click   += self.Button1Click
		self._btn_inter.UseVisualStyleBackColor = True
		# 
		# Form24
		# 
		self.ClientSize      = System.Drawing.Size(250, 85)
		self.MaximizeBox     = 0
		self.MinimizeBox     = 0
		self.FormBorderStyle = FormBorderStyle.FixedSingle
		self.CenterToScreen() 
		self.Controls.Add(self._spr_top)
		self.Controls.Add(self._txtBlock)
		self.Controls.Add(self._btn_inter)
		self.Controls.Add(self._progressBar)
		self.Name = "Processing..."
		self.Text = "Processing..."
		#Icons to show in the corner of the window.
		#iconFilename = 'C:\\NONICAPRO\\OtherFiles\\System\\Nonicafavicon.ICO'
		#if not os.path.exists(iconFilename):
			#iconFilename = 'C:\\NONICA\\OtherFiles\\System\\Nonicafavicon.ICO'
		#icon = Icon(iconFilename)
		#self.Icon = icon
		self.ResumeLayout(False)
		
	def Button1Click(self, sender, e):
		#If interrupted is pressed, change interrupted variable.
		self.interrupt = True
		
	def closingevent(self, sender, e):
		#If window is closed, change interrupted variable.
		self.interrupt = True

################################

#STATIC FUNCTIONS. General functions to call.

################################

#Eventually failure processing, to swallow non-critical warnings.
"""
def OnFailuresProcessing(sender, e):
	a = e.GetFailuresAccessor()
	failures = a.GetFailureMessages()
	for f in failures:
		fseverity = a.GetSeverity()
		if fseverity == FailureSeverity.Warning:
			a.DeleteWarning(f)
		else:
			a.ResolveFailure(f)
			return FailureProcessingResult.ProceedWithCommit
	return FailureProcessingResult.Continue

#How to use:
	1-Create EventHandler in Main.
		global failureProc
		failureProc = System.EventHandler[Autodesk.Revit.DB.Events.FailuresProcessingEventArgs](OnFailuresProcessing)
	2-Subscription and unsub in external event.
		uiapp.Application.FailuresProcessing += failureProc
		#Transaction goes here.
		uiapp.Application.FailuresProcessing -= failureProc		
"""

################################

#MAIN. Main thread. Only shows the main window.

################################

#Basic variables if preview info in window required, like sheets or views to select.
#doc = DocumentManager.Instance.CurrentDBDocument
#uiapp = DocumentManager.Instance.CurrentUIApplication
#uidoc = uiapp.ActiveUIDocument

#Create external event instance.
event_hnd = myExternalEvent()
ext_event = ExternalEvent.Create(event_hnd)

#Create and show main window. Pass ext. event and any other preview info.
global mainWindow
mainWindow = MainWindow(ext_event)
mainWindow.Show()

OUT = 0

#Python Template by Nonica.io

################################

#LICENSE PYTHON TEMPLATE. 
	#You are free to:
    	#Share — copy and redistribute the material in any medium or format.
        #Adapt — remix, transform, and build upon the material.
	#You cannot:
    	#NonCommercial — Sell or re-sell the material.
        #Remove licensing or attributions Nonica

################################
"""
CC Attribution-NonCommercial-ShareAlike 4.0 International

By exercising the Licensed Rights (defined below), You accept and agree to be bound by the terms and conditions of this Creative Commons Attribution-NonCommercial-ShareAlike 4.0 International Public License ("Public License"). To the extent this Public License may be interpreted as a contract, You are granted the Licensed Rights in consideration of Your acceptance of these terms and conditions, and the Licensor grants You such rights in consideration of benefits the Licensor receives from making the Licensed Material available under these terms and conditions.

Section 1 – Definitions.
Adapted Material means material subject to Copyright and Similar Rights that is derived from or based upon the Licensed Material and in which the Licensed Material is translated, altered, arranged, transformed, or otherwise modified in a manner requiring permission under the Copyright and Similar Rights held by the Licensor. For purposes of this Public License, where the Licensed Material is a musical work, performance, or sound recording, Adapted Material is always produced where the Licensed Material is synched in timed relation with a moving image.
Adapter's License means the license You apply to Your Copyright and Similar Rights in Your contributions to Adapted Material in accordance with the terms and conditions of this Public License.
BY-NC-SA Compatible License means a license listed at creativecommons.org/compatiblelicenses , approved by Creative Commons as essentially the equivalent of this Public License.
Copyright and Similar Rights means copyright and/or similar rights closely related to copyright including, without limitation, performance, broadcast, sound recording, and Sui Generis Database Rights, without regard to how the rights are labeled or categorized. For purposes of this Public License, the rights specified in Section 2(b)(1)-(2) are not Copyright and Similar Rights.
Effective Technological Measures means those measures that, in the absence of proper authority, may not be circumvented under laws fulfilling obligations under Article 11 of the WIPO Copyright Treaty adopted on December 20, 1996, and/or similar international agreements.
Exceptions and Limitations means fair use, fair dealing, and/or any other exception or limitation to Copyright and Similar Rights that applies to Your use of the Licensed Material.
License Elements means the license attributes listed in the name of a Creative Commons Public License. The License Elements of this Public License are Attribution, NonCommercial, and ShareAlike.
Licensed Material means the artistic or literary work, database, or other material to which the Licensor applied this Public License.
Licensed Rights means the rights granted to You subject to the terms and conditions of this Public License, which are limited to all Copyright and Similar Rights that apply to Your use of the Licensed Material and that the Licensor has authority to license.
Licensor means the individual(s) or entity(ies) granting rights under this Public License.
NonCommercial means not primarily intended for or directed towards commercial advantage or monetary compensation. For purposes of this Public License, the exchange of the Licensed Material for other material subject to Copyright and Similar Rights by digital file-sharing or similar means is NonCommercial provided there is no payment of monetary compensation in connection with the exchange.
Share means to provide material to the public by any means or process that requires permission under the Licensed Rights, such as reproduction, public display, public performance, distribution, dissemination, communication, or importation, and to make material available to the public including in ways that members of the public may access the material from a place and at a time individually chosen by them.
Sui Generis Database Rights means rights other than copyright resulting from Directive 96/9/EC of the European Parliament and of the Council of 11 March 1996 on the legal protection of databases, as amended and/or succeeded, as well as other essentially equivalent rights anywhere in the world.
You means the individual or entity exercising the Licensed Rights under this Public License. Your has a corresponding meaning.
Section 2 – Scope.
License grant .
Subject to the terms and conditions of this Public License, the Licensor hereby grants You a worldwide, royalty-free, non-sublicensable, non-exclusive, irrevocable license to exercise the Licensed Rights in the Licensed Material to:
reproduce and Share the Licensed Material, in whole or in part, for NonCommercial purposes only; and
produce, reproduce, and Share Adapted Material for NonCommercial purposes only.
Exceptions and Limitations . For the avoidance of doubt, where Exceptions and Limitations apply to Your use, this Public License does not apply, and You do not need to comply with its terms and conditions.
Term . The term of this Public License is specified in Section 6(a) .
Media and formats; technical modifications allowed . The Licensor authorizes You to exercise the Licensed Rights in all media and formats whether now known or hereafter created, and to make technical modifications necessary to do so. The Licensor waives and/or agrees not to assert any right or authority to forbid You from making technical modifications necessary to exercise the Licensed Rights, including technical modifications necessary to circumvent Effective Technological Measures. For purposes of this Public License, simply making modifications authorized by this Section 2(a)(4) never produces Adapted Material.
Downstream recipients .
Offer from the Licensor – Licensed Material . Every recipient of the Licensed Material automatically receives an offer from the Licensor to exercise the Licensed Rights under the terms and conditions of this Public License.
Additional offer from the Licensor – Adapted Material . Every recipient of Adapted Material from You automatically receives an offer from the Licensor to exercise the Licensed Rights in the Adapted Material under the conditions of the Adapter’s License You apply.
No downstream restrictions . You may not offer or impose any additional or different terms or conditions on, or apply any Effective Technological Measures to, the Licensed Material if doing so restricts exercise of the Licensed Rights by any recipient of the Licensed Material.
No endorsement . Nothing in this Public License constitutes or may be construed as permission to assert or imply that You are, or that Your use of the Licensed Material is, connected with, or sponsored, endorsed, or granted official status by, the Licensor or others designated to receive attribution as provided in Section 3(a)(1)(A)(i) .
Other rights .
Moral rights, such as the right of integrity, are not licensed under this Public License, nor are publicity, privacy, and/or other similar personality rights; however, to the extent possible, the Licensor waives and/or agrees not to assert any such rights held by the Licensor to the limited extent necessary to allow You to exercise the Licensed Rights, but not otherwise.
Patent and trademark rights are not licensed under this Public License.
To the extent possible, the Licensor waives any right to collect royalties from You for the exercise of the Licensed Rights, whether directly or through a collecting society under any voluntary or waivable statutory or compulsory licensing scheme. In all other cases the Licensor expressly reserves any right to collect such royalties, including when the Licensed Material is used other than for NonCommercial purposes.
Section 3 – License Conditions.
Your exercise of the Licensed Rights is expressly made subject to the following conditions.

Attribution .
If You Share the Licensed Material (including in modified form), You must:

retain the following if it is supplied by the Licensor with the Licensed Material:
identification of the creator(s) of the Licensed Material and any others designated to receive attribution, in any reasonable manner requested by the Licensor (including by pseudonym if designated);
a copyright notice;
a notice that refers to this Public License;
a notice that refers to the disclaimer of warranties;
a URI or hyperlink to the Licensed Material to the extent reasonably practicable;
indicate if You modified the Licensed Material and retain an indication of any previous modifications; and
indicate the Licensed Material is licensed under this Public License, and include the text of, or the URI or hyperlink to, this Public License.
You may satisfy the conditions in Section 3(a)(1) in any reasonable manner based on the medium, means, and context in which You Share the Licensed Material. For example, it may be reasonable to satisfy the conditions by providing a URI or hyperlink to a resource that includes the required information.
If requested by the Licensor, You must remove any of the information required by Section 3(a)(1)(A) to the extent reasonably practicable.
ShareAlike .
In addition to the conditions in Section 3(a) , if You Share Adapted Material You produce, the following conditions also apply.

The Adapter’s License You apply must be a Creative Commons license with the same License Elements, this version or later, or a BY-NC-SA Compatible License.
You must include the text of, or the URI or hyperlink to, the Adapter's License You apply. You may satisfy this condition in any reasonable manner based on the medium, means, and context in which You Share Adapted Material.
You may not offer or impose any additional or different terms or conditions on, or apply any Effective Technological Measures to, Adapted Material that restrict exercise of the rights granted under the Adapter's License You apply.
Section 4 – Sui Generis Database Rights.
Where the Licensed Rights include Sui Generis Database Rights that apply to Your use of the Licensed Material:

for the avoidance of doubt, Section 2(a)(1) grants You the right to extract, reuse, reproduce, and Share all or a substantial portion of the contents of the database for NonCommercial purposes only;
if You include all or a substantial portion of the database contents in a database in which You have Sui Generis Database Rights, then the database in which You have Sui Generis Database Rights (but not its individual contents) is Adapted Material, including for purposes of Section 3(b) ; and
You must comply with the conditions in Section 3(a) if You Share all or a substantial portion of the contents of the database.
For the avoidance of doubt, this Section 4 supplements and does not replace Your obligations under this Public License where the Licensed Rights include other Copyright and Similar Rights.

Section 5 – Disclaimer of Warranties and Limitation of Liability.
Unless otherwise separately undertaken by the Licensor, to the extent possible, the Licensor offers the Licensed Material as-is and as-available, and makes no representations or warranties of any kind concerning the Licensed Material, whether express, implied, statutory, or other. This includes, without limitation, warranties of title, merchantability, fitness for a particular purpose, non-infringement, absence of latent or other defects, accuracy, or the presence or absence of errors, whether or not known or discoverable. Where disclaimers of warranties are not allowed in full or in part, this disclaimer may not apply to You.
To the extent possible, in no event will the Licensor be liable to You on any legal theory (including, without limitation, negligence) or otherwise for any direct, special, indirect, incidental, consequential, punitive, exemplary, or other losses, costs, expenses, or damages arising out of this Public License or use of the Licensed Material, even if the Licensor has been advised of the possibility of such losses, costs, expenses, or damages. Where a limitation of liability is not allowed in full or in part, this limitation may not apply to You.
The disclaimer of warranties and limitation of liability provided above shall be interpreted in a manner that, to the extent possible, most closely approximates an absolute disclaimer and waiver of all liability.
Section 6 – Term and Termination.
This Public License applies for the term of the Copyright and Similar Rights licensed here. However, if You fail to comply with this Public License, then Your rights under this Public License terminate automatically.
Where Your right to use the Licensed Material has terminated under Section 6(a), it reinstates:

automatically as of the date the violation is cured, provided it is cured within 30 days of Your discovery of the violation; or
upon express reinstatement by the Licensor.
For the avoidance of doubt, this Section 6(b) does not affect any right the Licensor may have to seek remedies for Your violations of this Public License.

For the avoidance of doubt, the Licensor may also offer the Licensed Material under separate terms or conditions or stop distributing the Licensed Material at any time; however, doing so will not terminate this Public License.
Sections 1 , 5 , 6 , 7 , and 8 survive termination of this Public License.
Section 7 – Other Terms and Conditions.
The Licensor shall not be bound by any additional or different terms or conditions communicated by You unless expressly agreed.
Any arrangements, understandings, or agreements regarding the Licensed Material not stated herein are separate from and independent of the terms and conditions of this Public License.
Section 8 – Interpretation.
For the avoidance of doubt, this Public License does not, and shall not be interpreted to, reduce, limit, restrict, or impose conditions on any use of the Licensed Material that could lawfully be made without permission under this Public License.
To the extent possible, if any provision of this Public License is deemed unenforceable, it shall be automatically reformed to the minimum extent necessary to make it enforceable. If the provision cannot be reformed, it shall be severed from this Public License without affecting the enforceability of the remaining terms and conditions.
No term or condition of this Public License will be waived and no failure to comply consented to unless expressly agreed to by the Licensor.
Nothing in this Public License constitutes or may be interpreted as a limitation upon, or waiver of, any privileges and immunities that apply to the Licensor or You, including from the legal processes of any jurisdiction or authority.
"""
# ----------------------------------------
